# Dynamo graph StealthyRoofscapes_CreateForm.dyn (Dynamo 2.0.2.6826)

# group: Select File
file_path = Filename("C:\Users\thomas.corrie\Box Sync\Dynamo Hackathon 2019\1-ground.sat")  # frozen
file_path_2 = Filename("C:\Users\thomas.corrie\Box Sync\Dynamo Hackathon 2019\1-roof.sat")
file_path_3 = Filename("C:\Users\thomas.corrie\Box Sync\Dynamo Hackathon 2019\1-points.sat")
file_path_4 = Filename("C:\Users\thomas.corrie\Box Sync\Dynamo Hackathon 2019\1-buildings.sat")

# group: SAT Imports
ground_surface = Geometry.ImportFromSAT(filePath=file_path)
roof_surface = Geometry.ImportFromSAT(filePath=file_path_2)
viewpoints = Geometry.ImportFromSAT(filePath=file_path_3)
buildings = Geometry.ImportFromSAT(filePath=file_path_4)

# group: Point at Centre of Roof
code_block = CodeBlock { 0.5; }
pointAtParameter = Surface.PointAtParameter(surface=roof_surface, u=code_block, v=code_block)

# group: Box Variables
rotation = DoubleSlider(38.98789148, range=0..180 step 1)  # graph input
length = DoubleSlider(22.55832079, range=0.5..100 step 0.5)  # graph input
width = DoubleSlider(42.50059927, range=0.5..100 step 0.5)  # graph input
height = DoubleSlider(6.787915607, range=4..30 step 0.5)  # graph input
XOffset = DoubleSlider(44.76805141, range=0..100 step 0.5)  # graph input
YOffset = DoubleSlider(49.58122414, range=0..100 step 0.5)  # graph input

# group: Roof CoordinateSystem
byOrigin = CoordinateSystem.ByOrigin(origin=pointAtParameter)
origin = CoordinateSystem.Origin(coordinateSystem=byOrigin)
ZAxis = CoordinateSystem.ZAxis(coordinateSystem=byOrigin)
rotate = CoordinateSystem.Rotate(coordinateSystem=byOrigin, origin=origin, axis=ZAxis, degrees=rotation)
XAxis = CoordinateSystem.XAxis(coordinateSystem=byOrigin)
YAxis = CoordinateSystem.YAxis(coordinateSystem=byOrigin)

code_block_2 = CodeBlock(x=length, y=width) { [x/2,x/2,-x/2,-x/2]; [y/2,-y/2,-y/2,y/2]; }

# group: Get Intersection of Surfaces
byCartesianCoordinates = Point.ByCartesianCoordinates(cs=rotate, x=code_block_2.out0, y=code_block_2.out1)
byPoints = Polygon.ByPoints(points=byCartesianCoordinates)
byPatch = Surface.ByPatch(closedCurve=byPoints)
intersect = Geometry.Intersect(geometry=byPatch, other=roof_surface)
area = Surface.Area(surface=intersect)
sortByKey = List.SortByKey(list=intersect, keys=area)
lastItem = List.LastItem(list=sortByKey.sorted_list)

# group: Box Create cuboid, move in X and Y, and then
byLengths = Cuboid.ByLengths(origin=rotate, width=length, length=width, height=height)
translate = Geometry.Translate(geometry=byLengths, direction=XAxis, distance=XOffset)
translate_2 = Geometry.Translate(geometry=translate, direction=YAxis, distance=YOffset)
code_block_3 = CodeBlock { 0.5; }
normalAtParameter = Surface.NormalAtParameter(surface=lastItem, u=code_block_3, v=code_block_3)
code_block_4 = CodeBlock(v=normalAtParameter) { v.Z < 0; }
boolean = BoolSelector(false)
thicken = Surface.Thicken(surface=lastItem, thickness=height, both_sides=boolean)
translate_3 = Geometry.Translate(geometry=thicken, zTranslation=height)
if_ = If(test=code_block_4, true=translate_3, false=thicken)

# group: Volume - High is Better
volume = Solid.Volume(solid=if_)
volume_2 = Watch(volume)  # graph output

eyepoint_above_plane = CodeBlock { 2; }
translate_4 = Geometry.Translate(geometry=viewpoints, zTranslation=eyepoint_above_plane)

# group: SELECTION LIMIT
code_block_5 = CodeBlock(x=translate_4) { x[0..30..5]; }

# group: Get Normal for each Face
faces = Topology.Faces(topology=if_)
surfaceGeometry = Face.SurfaceGeometry(face=faces)
code_block_6 = CodeBlock { 0.5; }
normalAtParameter_2 = Surface.NormalAtParameter(surface=surfaceGeometry, u=code_block_6, v=code_block_6)
pointAtParameter_2 = Surface.PointAtParameter(surface=surfaceGeometry, u=code_block_6, v=code_block_6)

# group: Filter out Top and Bottom Surfaces
X = Vector.X(vector=normalAtParameter_2)
code_block_7 = CodeBlock(x=X) { x==0; }
filterByBoolMask = List.FilterByBoolMask(list=surfaceGeometry, mask=code_block_7)
filterByBoolMask_2 = List.FilterByBoolMask(list=normalAtParameter_2, mask=code_block_7)

filterByBoolMask_3 = List.FilterByBoolMask(list=pointAtParameter_2, mask=code_block_7)

# group (continued): Get Normal for each Face
byTwoPoints = Vector.ByTwoPoints(start=code_block_5, end=filterByBoolMask_3.out, lacing=CrossProduct)

count = List.Count(list=byTwoPoints)

# group: Get Surfaces that are Facing the Viewpoint
code_block_8 = CodeBlock(x=filterByBoolMask.out) { x; }
code_block_9 = CodeBlock(x=code_block_8) { [x]; }
cycle = List.Cycle(list=code_block_9, amount=count)
angleWithVector = Vector.AngleWithVector(vector=filterByBoolMask_2.out, otherVector=byTwoPoints@L2)
code_block_10 = CodeBlock { 100; }
gt = angleWithVector > code_block_10
filterByBoolMask_4 = List.FilterByBoolMask(list=cycle, mask=gt)

code_block_11 = CodeBlock { 4; }

# group: Lunchbox Panels
panelQuad = Geometry.Panel.PanelQuad(srf=filterByBoolMask_4.in, u=code_block_11, v=code_block_11)

# group: Explode solids to Surfaces
explode = Geometry.Explode(geometry=buildings)
flatten = List.Flatten(list=explode)

# group: Python Calculate Sightlines and Scores
python_script = Python(IN[0]=code_block_5, IN[1]=panelQuad.Panels, IN[2]=flatten)
# ---------- python_script.python (71 lines) ----------
# Enable Python support and load DesignScript library
import clr
clr.AddReference('ProtoGeometry')
from Autodesk.DesignScript.Geometry import *

import math

# The inputs to this node will be stored as a list in the IN variables.
points = IN[0]
panels = IN[1]
buildings = IN[2]

lines = []
truncLines = []
truncLinesCol = []
dists = []
buildingsSort = []
keysSort = []
bools = []
scores = []
pansFail = []
pansPass = []

for p1, bPanels in zip(points, panels): # single viewpoint
	#dists.append([])
	dist = []
	bools.append([])
	for b in buildings: # loop through surfaces of buildings and get distance from viewpoint
		dist.append(Geometry.DistanceTo(p1, b))
	dists.append(dist)
	bSort = [x for _,x in sorted(zip(dist,buildings))] # sort by distance from viewpoint
	buildingsSort.append(bSort)
	#dists.append(dist)
	lines.append([])
	truncLines.append([])
	truncLinesCol.append([])
	score = 0
	panPass = 0
	panFail = 0
	for sPanels in bPanels: # side panels in viewpoint
		lines[-1].append([])
		truncLines[-1].append([])
		truncLinesCol[-1].append([])
		bools[-1].append([])
		for pan in sPanels: # for each panel
			p2 = Surface.PointAtParameter(pan, 0.5, 0.5)
			ln = Line.ByStartPointEndPoint(p1,p2)
			lines[-1][-1].append(ln)
			bool = False
			for b in bSort:
				if Geometry.DoesIntersect(b, ln):
					tp = Geometry.Intersect(b, ln)[0]
					truncLines[-1][-1].append(Line.ByStartPointEndPoint(p1,tp))
					truncLinesCol[-1][-1].append(0)
					bool = True
					break
			bools[-1][-1].append(bool)
			if bool:
				panPass += 1
			else:
				panFail += 1
				truncLines[-1][-1].append(ln)
				truncLinesCol[-1][-1].append(1)
	score = float(panPass) / (panPass + panFail) * 100
	scores.append(score)
	pansFail.append(panFail)
	pansPass.append(panPass)
					

# Assign your output to the OUT variable.
OUT = truncLines, bools, scores, pansFail, pansPass, truncLinesCol
# ----------------------------------------
code_block_12 = CodeBlock(x=python_script) { truncLines = x[0]; bools = x[1]; scores = x[2]; pansFail = x[3]; pansPass = x[4]; truncLinesCol = x[5]; }

# group: Mean Score for Form - High is Better
viewpoint_scores = Watch(code_block_12.scores)
mean_score = Math.Average(numbers=viewpoint_scores)
mean_score_2 = Watch(mean_score)  # graph output

# group: Spheres at Viewpoints
sphere_size = CodeBlock { 5; }
byCenterPointRadius = Sphere.ByCenterPointRadius(centerPoint=code_block_5, radius=sphere_size)
color_palette = ColorPalette({R: 255, G: 69, B: 0, A: 255})
color_palette_2 = ColorPalette({R: 127, G: 255, B: 0, A: 255})
code_block_13 = CodeBlock(r=color_palette, g=color_palette_2) { [r,r,g]; }
code_block_14 = CodeBlock { [0,0.75,1]; }
code_block_15 = CodeBlock { 0; 100; 1; }
mapTo = Math.MapTo(rangeMin=code_block_15.out0, rangeMax=code_block_15.out1, inputValue=viewpoint_scores, targetRangeMin=code_block_15.out0, targetRangeMax=code_block_15.out2)
color_range = ColorRange(colors=code_block_13, indices=code_block_14, value=mapTo)
byGeometryColor = Modifiers.GeometryColor.ByGeometryColor(geometry=byCenterPointRadius, color=color_range)

# group: Sightlines
code_block_16 = CodeBlock(g=color_palette_2, r=color_palette) { [g,r]; }
code_block_17 = CodeBlock(x=python_script) { x[5]; }
code_block_18 = CodeBlock(c=code_block_16, x=code_block_17) { c[x]; }
byGeometryColor_2 = Modifiers.GeometryColor.ByGeometryColor(geometry=code_block_12.truncLines, color=code_block_18)
